# Grasshopper definition Bolas_parametrizadas_v9_-_ORGANIZAR_INPUTS.gh (Grasshopper 0.9.76)
# plug-ins: LunchBox

# ---- group: Extensão das linhas de Eixo
number_slider = Slider(25, range=0..100)

# ---- group: Selecionar planos do grid
surface = Surface([<surface referenced from the Rhino model> x29])

# ---- group: Selecionar geometrias das esferas
geometry = Geometry([<brep referenced from the Rhino model> x485])

# ---- group: Número Inicial da Contagem de Bolas
panel = Panel("1")

# ---- group: Organiza a ordem dos Grides
deconstruct_brep = DeconstructBrep(Brep=surface)  # -> Faces, Edges, Vertices
cull_pattern = CullPattern(List=deconstruct_brep.Vertices, CullPattern=[True, False, False, False])
point = Point(flatten(cull_pattern))
area = Area(Geometry=surface)  # -> Area, Centroid
evaluate = Evaluate(Expression="-P.y*100 + P.x", P=point)
sort_list = SortList(Keys=evaluate, ValuesValuesA=area.Centroid)  # -> Keys, ValuesValuesA
sort_list_2 = SortList(Keys=evaluate, ValuesValuesA=surface)  # -> Keys, ValuesValuesA

# ---- group: Nome dos Grides / Cria uma lista em ordem alfabética
list_length = ListLength(List=sort_list_2.ValuesValuesA)
sequence = Sequence(Count=list_length, CharPool="ABCDEFGHIJKLMNOPQRSTUVWXYZ", Format="{0}")  # -> flatten(Sequence)

# ---- group: Nome dos Grides
panel_2 = Panel(sequence)
text_tag_3d = TextTag3D(Location=sort_list.ValuesValuesA, Text=panel_2, Size=50, Justification=5)
graft_tree = GraftTree(Tree=panel_2, IncludeEmptyLists=True, IncludeNullItems=True)
panel_3 = Panel(graft_tree)

# ---- group: Separa as Bolas por Proximidade aos Grides
volume = Volume(Geometry=geometry)  # -> Volume, Centroid
closest_point = ClosestPoint(Point=volume.Centroid, Cloud=sort_list.ValuesValuesA)  # -> ClosestPoint, CPIndex, Distance
sort_list_3 = SortList(Keys=closest_point.CPIndex, ValuesValuesA=geometry)  # -> Keys, ValuesValuesA
create_set = CreateSet(List=sort_list_3.Keys)  # -> Set, Map
member_index = MemberIndex(Set=sort_list_3.Keys, Member=create_set.Set)  # -> simplify(Index), Count
list_item = ListItem(List=sort_list_3.ValuesValuesA, Index=member_index.Index, Wrap=True)

# ---- group: Organiza as esferas da esquerda pra a direita, de baixo para cima
volume_2 = Volume(Geometry=list_item)  # -> Volume, Centroid
evaluate_2 = Evaluate(Expression="P.x*1000 + P.y*10 + P.z", P=volume_2.Centroid)
sort_list_4 = SortList(Keys=evaluate_2, ValuesValuesA=list_item)  # -> Keys, ValuesValuesA
sort_list_5 = SortList(Keys=evaluate_2, ValuesValuesA=volume_2.Centroid)  # -> Keys, ValuesValuesA

# ---- group: Numero da Bola
list_length_2 = ListLength(List=sort_list_5.ValuesValuesA)
series = Series(Start=panel, Step=1, Count=list_length_2)
integer = Integer(series)

# ---- group: Texto Bolas
concatenate = Concatenate(A=panel_3, B="-", C=integer)

# ---- group: Só para verificar se a ordem das bolas está ok
tree_item = TreeItem(Tree=sort_list_4.ValuesValuesA, Path="{0}", Index=Slider(3, range=0..10), Wrap=True)

# ---- group: Texto das Bolas
list_length_3 = ListLength(List=sort_list_4.ValuesValuesA)
series_2 = Series(Start=1, Step=1, Count=flatten(list_length_3))
integer_2 = Integer(series_2)
concatenate_2 = Concatenate(FragmentA=panel_3, FragmentB=integer_2)
text_tag_3d_2 = TextTag3D(Location=sort_list_5.ValuesValuesA, Text=concatenate_2, Size=16, Justification=7)

# ---- group: Decompõe os planos do Gride em seus componentes
deconstruct_brep_2 = DeconstructBrep(Brep=sort_list_2.ValuesValuesA)  # -> Faces, simplify(Edges), simplify(Vertices)

# ---- group: Linha lateral direita de cada Gride
panel_4 = Panel("""0
1
1
0""")
cull_pattern_2 = CullPattern(List=deconstruct_brep_2.Vertices, CullPattern=panel_4)
shift_list = ShiftList(List=cull_pattern_2, Shift=1, Wrap=True)
line = Line(StartPoint=cull_pattern_2, EndPoint=shift_list)

panel_5 = Panel("""1
1
0
0""")
cull_pattern_3 = CullPattern(List=deconstruct_brep_2.Vertices, CullPattern=panel_5)
shift_list_2 = ShiftList(List=cull_pattern_3, Shift=1, Wrap=True)
line_2 = Line(StartPoint=cull_pattern_3, EndPoint=shift_list_2)

# ---- group: Acha o Ponto mais próximo entre o Centro da Esfera e a Borda do Gride
curve_closest_point = CurveClosestPoint(Point=sort_list_5.ValuesValuesA, Curve=line_2)  # -> Point, Parameter, Distance

curve_closest_point_2 = CurveClosestPoint(Point=sort_list_5.ValuesValuesA, Curve=line)  # -> Point, Parameter, Distance

# ---- group: Distância entre o plano do grid e as esfera do projeto conceitual
plane_closest_point = PlaneClosestPoint(Point=sort_list_5.ValuesValuesA, Plane=graft(sort_list_2.ValuesValuesA))  # -> Point, UVPoint, Distance

# ---- group: Diâmetro das esferas do projeto conceitual
brep_closest_point = BrepClosestPoint(Point=sort_list_5.ValuesValuesA, Brep=sort_list_4.ValuesValuesA)  # -> Point, Distance

# ---- group: Distância entre os Grides
number_slider_2 = Slider(805, range=0..5000)

# ----
surface_2 = Surface(simplify(graft(sort_list_2.ValuesValuesA)))

# ---- group: Distância da origem
number_slider_3 = Slider(100, range=-10000..10001)

# ----
deconstruct_brep_3 = DeconstructBrep(Brep=surface_2)  # -> Faces, Edges, Vertices
list_length_4 = ListLength(List=sort_list_2.ValuesValuesA)
join_curves = JoinCurves(Curves=deconstruct_brep_3.Edges, Preserve=False)
series_3 = Series(Start=number_slider_3, Step=number_slider_2, Count=list_length_4)
construct_point = ConstructPoint(XCoordinate=series_3, YCoordinate=number_slider_3, ZCoordinate=0)
orient = Orient(Geometry=simplify(join_curves), Source=surface_2, Target=simplify(graft(construct_point)))  # -> Geometry, Transform

# ---- group: BAKE THESE
button = Button()

# ---- group: Nome do novo Layer
concatenate_3 = Concatenate(A="Bolas ", D=" - Inferior Ajustadas")
panel_6 = Panel(concatenate_3)

# ---- group: Comprimento do Eixo Y
panel_7 = Panel("""0
0
1
1""")
cull_pattern_4 = CullPattern(List=deconstruct_brep_2.Vertices, CullPattern=panel_7)
shift_list_3 = ShiftList(List=cull_pattern_4, Shift=-1, Wrap=True)
line_3 = Line(StartPoint=cull_pattern_4, EndPoint=shift_list_3)

# ---- group: Comprimento do Eixo X
panel_8 = Panel("""1
0
0
1""")
cull_pattern_5 = CullPattern(List=deconstruct_brep_2.Vertices, CullPattern=panel_8)
shift_list_4 = ShiftList(List=cull_pattern_5, Shift=-1, Wrap=True)
line_4 = Line(StartPoint=cull_pattern_5, EndPoint=shift_list_4)

# ---- group: Ponto médio entre os que estão dentro do Raio / Raio de Tolerância (proximidade entre os pontos)
slider = Slider(8, range=0..10)

# ---- group: Ponto médio entre os que estão dentro do Raio
simplify_pts = CSharpScript(pts=curve_closest_point.Point, tol=slider)  # -> out, A; inputs pts: list of Point3d, tol: Double
# ---------- simplify_pts: C# ----------
    bool go;
    int n = 0;

    if(tol > 0)
    {
      do
      {
        go = Converge(pts, tol);
        n += 1;
      }
      while(go);
    }


    Print("Iterations " + Convert.ToString(n));
    A = pts;
# ---------- simplify_pts: C# additional code ----------
  private bool Converge(List<Point3d> pts, double tol)
  {
    Vector3d[] DeltaPos = new Vector3d[pts.Count];
    bool check = false;
    tol = Math.Pow(tol, 2);

    for(int i = 0; i < pts.Count; i++)
    {
      DeltaPos[i] = LocalCentroid(pts[i], pts, tol) - pts[i];
      if(DeltaPos[i].X + DeltaPos[i].Y + DeltaPos[i].Z > doc.ModelAbsoluteTolerance)
      {
        check = true;
      }
    }

    for (int i = 0; i < pts.Count; i++)
    {
      pts[i] += DeltaPos[i];
    }

    return check;
  }


  private Point3d LocalCentroid(Point3d p, List<Point3d> pts, double tolSqr)
  {
    Point3d cntr = new Point3d(0, 0, 0);
    Vector3d testVec;
    double lsqr;
    int count = 0;

    for (int i = 0; i < pts.Count; i++)
    {
      testVec = pts[i] - p;
      lsqr = testVec.SquareLength;

      if (lsqr < tolSqr)
      {
        cntr += pts[i];
        count += 1;
      }
    }

    return cntr / count;
  }
# ---------- end simplify_pts ----------

# ---- group: Ponto médio entre os que estão dentro do Raio / Raio de Tolerância (proximidade entre os pontos) (continued)
cir = Circle(Plane=simplify_pts.A, Radius=slider)

# ---- group: Remove pontos repetidos
cull_duplicates = CullDuplicates(Points=simplify_pts.A, Tolerance=0.1, CullMode=3)  # -> simplify(Points), Indices, Valence

# ---- group: Comprimento do Eixo Y (continued)
curve_closest_point_3 = CurveClosestPoint(Point=cull_duplicates.Points, Curve=line_3)  # -> Point, Parameter, Distance

# ---- group: Linhas do Eixo Y
unit_y = UnitY(Factor=1)
evaluate_3 = Evaluate(Expression="x+y", x=curve_closest_point_3.Distance, y=number_slider)
line_sdl = LineSDL(Start=cull_duplicates.Points, Direction=unit_y, Length=evaluate_3)  # -> simplify(Line)

# ---- group: Texto Linhas Verticais
list_length_5 = ListLength(List=line_sdl)
series_4 = Series(Start=1, Step=1, Count=list_length_5)
integer_3 = Integer(series_4)
concatenate_4 = Concatenate(A="Y", B=".", C=integer_3)

# ----
curve = Curve(line_sdl)
orient_2 = Orient(Geometry=simplify(cull_duplicates.Points), Source=surface_2, Target=simplify(graft(construct_point)))  # -> Geometry, Transform

# ---- group: Ponto médio entre os que estão dentro do Raio / Raio de Tolerância (proximidade entre os pontos)
slider_2 = Slider(8, range=0..10)

# ---- group: Ponto médio entre os que estão dentro do Raio
simplify_pts_2 = CSharpScript(pts=curve_closest_point_2.Point, tol=slider_2)  # -> out, A; inputs pts: list of Point3d, tol: Double; same code as simplify_pts

# ---- group: Ponto médio entre os que estão dentro do Raio / Raio de Tolerância (proximidade entre os pontos) (continued)
cir_2 = Circle(Plane=simplify_pts_2.A, Radius=slider_2)

# ---- group: Remove pontos repetidos
cull_duplicates_2 = CullDuplicates(Points=simplify_pts_2.A, Tolerance=0.1, CullMode=3)  # -> simplify(Points), Indices, Valence

# ---- group: Comprimento do Eixo X (continued)
curve_closest_point_4 = CurveClosestPoint(Point=cull_duplicates_2.Points, Curve=line_4)  # -> Point, Parameter, Distance

# ---- group: Linhas do Eixo X
unit_x = UnitX(Factor=1)
evaluate_4 = Evaluate(Expression="x*-1-y", x=curve_closest_point_4.Distance, y=number_slider)
line_sdl_2 = LineSDL(Start=cull_duplicates_2.Points, Direction=unit_x, Length=evaluate_4)  # -> simplify(Line)

# ---- group: Texto Linhas Horizontais
list_length_6 = ListLength(List=line_sdl_2)
series_5 = Series(Start=1, Step=1, Count=list_length_6)
integer_4 = Integer(series_5)
concatenate_5 = Concatenate(A=panel_3, D=".", C=integer_4)

# ---- group: Acha a Intersecção entre os Eixos do gride
multiple_curves = MultipleCurves(Curves=[line_sdl_2, line_sdl])  # -> Points, IndexA, IndexB, ParamA, ParamB
closest_point_2 = ClosestPoint(Point=sort_list_5.ValuesValuesA, Cloud=multiple_curves.Points)  # -> ClosestPoint, CPIndex, Distance

# ---- group: Move os novos centros das esferas para a altura correta
unit_z = UnitZ(Factor=plane_closest_point.Distance)
move = Move(Geometry=closest_point_2.ClosestPoint, Motion=unit_z)  # -> Geometry, Transform

# ---- group: Cria NOVAS ESFERAS apartir dos centros calculados pela tolerância
vector_2pt = Vector2Pt(PointA=sort_list_5.ValuesValuesA, PointB=move.Geometry, Unitize=False)  # -> Vector, Length
move_2 = Move(Geometry=sort_list_4.ValuesValuesA, Motion=vector_2pt.Vector)  # -> simplify(Geometry), Transform

# ---- group: Distância entre centro e superfície da esfera
brep_closest_point_2 = BrepClosestPoint(Point=move.Geometry, Brep=move_2.Geometry)  # -> Point, Distance

# ---- group: Diâmetro
multiplication = Multiplication(A=brep_closest_point_2.Distance, B=2)
diâmetros = Panel(multiplication)
integer_5 = Integer(diâmetros)

# ----
geometry_2 = Geometry(move_2.Geometry)
orient_3 = Orient(Geometry=simplify(geometry_2), Source=surface_2, Target=simplify(graft(construct_point)))  # -> Geometry, Transform
orient_4 = Orient(Geometry=simplify(cull_duplicates_2.Points), Source=surface_2, Target=simplify(graft(construct_point)))  # -> Geometry, Transform
volume_3 = Volume(Geometry=orient_3.Geometry)  # -> Volume, Centroid
text_tag_3d_3 = TextTag3D(Location=volume_3.Centroid, Text=concatenate_2, Size=12, Justification=7)

# ---- group: Nome do novo Layer (continued)
geometry_3 = Geometry(move_2.Geometry)

# ---- group: Centro do Texto e Círculo
end_points = EndPoints(Curve=line_sdl_2)  # -> Start, End
number_slider_4 = Slider(-12, range=-100..100)
unit_x_2 = UnitX(Factor=number_slider_4)

# ---- group: Centro do Texto e Círculo / Ordem de crescente de P.y
evaluate_5 = Evaluate(Expression="-P.y", P=end_points.End)
sort_list_6 = SortList(Keys=evaluate_5, ValuesValuesA=end_points.End)  # -> Keys, ValuesValuesA

# ---- group: Centro do Texto e Círculo (continued)
move_3 = Move(Geometry=sort_list_6.ValuesValuesA, Motion=unit_x_2)  # -> Geometry, Transform
circle_cnr = CircleCNR(Center=move_3.Geometry, Normal=Vector(0, 0, 1), Radius=number_slider_4)

# ----
curve_2 = Curve(circle_cnr)
orient_5 = Orient(Geometry=simplify(curve_2), Source=surface_2, Target=simplify(graft(construct_point)))  # -> Geometry, Transform
area_2 = Area(Geometry=orient_5.Geometry)  # -> Area, Centroid

shift_list_5 = ShiftList(List=area_2.Centroid, Shift=-1, Wrap=True)
point_2 = Point(shift_list_5)
distance = Distance(PointA=area_2.Centroid, PointB=point_2)
evaluate_6 = Evaluate(Expression="If(x<18,-25,0)", x=distance)
unit_x_3 = UnitX(Factor=evaluate_6)
move_4 = Move(Geometry=orient_5.Geometry, Motion=unit_x_3)  # -> Geometry, Transform
area_3 = Area(Geometry=move_4.Geometry)  # -> Area, Centroid

shift_list_6 = ShiftList(List=area_3.Centroid, Shift=-1, Wrap=True)
point_3 = Point(shift_list_6)
distance_2 = Distance(PointA=area_3.Centroid, PointB=point_3)
evaluate_7 = Evaluate(Expression="If(x<18,25,0)", x=distance_2)
unit_x_4 = UnitX(Factor=evaluate_7)
move_5 = Move(Geometry=move_4.Geometry, Motion=unit_x_4)  # -> Geometry, Transform
area_4 = Area(Geometry=move_5.Geometry)  # -> Area, Centroid

text_tag_3d_4 = TextTag3D(Location=area_4.Centroid, Text=concatenate_5, Size=8, Justification=5)

evaluate_8 = Evaluate(Expression="-P.y", P=orient_4.Geometry)
sort_list_7 = SortList(Keys=evaluate_8, ValuesA=orient_4.Geometry)  # -> Keys, ValuesA
curve_closest_point_5 = CurveClosestPoint(Point=sort_list_7.ValuesA, Curve=move_5.Geometry)  # -> Point, Parameter, Distance

line_5 = Line(StartPoint=curve_closest_point_5.Point, EndPoint=sort_list_7.ValuesA)

# ---- group: BAKE THESE (continued)
text_tag_3d_5 = TextTag3D(Location=move_3.Geometry, Text=concatenate_5, Size=7, Justification=5)

# ---- group: Centro do Texto e Círculos
end_points_2 = EndPoints(Curve=line_sdl)  # -> Start, End
number_slider_5 = Slider(12, range=0..100)
unit_y_2 = UnitY(Factor=number_slider_5)

# ---- group: Centro do Texto e Círculos / Ordem de crescente de P.x
evaluate_9 = Evaluate(Expression="P.x", P=end_points_2.End)
sort_list_8 = SortList(Keys=evaluate_9, ValuesValuesA=end_points_2.End)  # -> Keys, ValuesValuesA

# ---- group: Centro do Texto e Círculos (continued)
move_6 = Move(Geometry=sort_list_8.ValuesValuesA, Motion=unit_y_2)  # -> Geometry, Transform
circle_cnr_2 = CircleCNR(Center=move_6.Geometry, Normal=Vector(0, 0, 1), Radius=number_slider_5)

# ---- group: BAKE THESE (continued)
text_tag_3d_6 = TextTag3D(Location=move_6.Geometry, Text=concatenate_4, Size=7, Justification=5)

# ---- group: Nome do novo Layer (continued)
curve_3 = Curve([circle_cnr, circle_cnr_2])
object_bake = ObjectBake(
    BakeToggle=button,
    GeometryObjects=[curve_3, geometry_3],
    Layer=concatenate_3,
    ObjectName="GH_Obj",
    ObjectColor=RGB(255, 255, 255),
    LayerColor=RGB(255, 255, 255))

# ----
curve_4 = Curve(circle_cnr_2)
orient_6 = Orient(Geometry=simplify(curve_4), Source=surface_2, Target=simplify(graft(construct_point)))  # -> Geometry, Transform
area_5 = Area(Geometry=orient_6.Geometry)  # -> Area, Centroid

# ---- group: CABOS
plane_closest_point_2 = PlaneClosestPoint(Point=move.Geometry, Plane=surface)  # -> Point, UVPoint, Distance
addition = Addition(A=plane_closest_point_2.Distance, B=brep_closest_point.Distance)
line_sdl_3 = LineSDL(Start=plane_closest_point_2.Point, Direction=Vector(0, 0, 1), Length=addition)
multiplication_2 = Multiplication(A=addition, B=-1)
pipe = Pipe(Curve=line_sdl_3, Radius=Slider(0.5, range=0..1), Caps=0)

# ----
integer_6 = Integer(multiplication_2)

# ---- group: Texto Tabela
concatenate_6 = Concatenate(
    Fragment_A=concatenate,
    Fragment_B=" D=",
    Fragment_C=integer_5,
    Fragment_D="cm Cabo=",
    Fragment_E=integer_6,
    Fragment_F="cm")

# ---- group: Lista de Bolas
panel_9 = Panel(concatenate_6)

# ---- group: CABOS (continued)
comprimento_do_cabo = Panel(integer_6)

# ----
shift_list_7 = ShiftList(List=area_5.Centroid, Shift=1, Wrap=True)
point_4 = Point(shift_list_7)
distance_3 = Distance(PointA=area_5.Centroid, PointB=point_4)
evaluate_10 = Evaluate(Expression="If(x<18,25,0)", x=distance_3)

unit_y_3 = UnitY(Factor=evaluate_10)

move_7 = Move(Geometry=orient_6.Geometry, Motion=unit_y_3)  # -> Geometry, Transform
area_6 = Area(Geometry=move_7.Geometry)  # -> Area, Centroid

shift_list_8 = ShiftList(List=area_6.Centroid, Shift=-1, Wrap=True)
point_5 = Point(shift_list_8)
distance_4 = Distance(PointA=area_6.Centroid, PointB=point_5)
evaluate_11 = Evaluate(Expression="If(x<18,-25,0)", x=distance_4)

unit_y_4 = UnitY(Factor=evaluate_11)

move_8 = Move(Geometry=move_7.Geometry, Motion=unit_y_4)  # -> Geometry, Transform
area_7 = Area(Geometry=move_8.Geometry)  # -> Area, Centroid

text_tag_3d_7 = TextTag3D(Location=area_7.Centroid, Text=concatenate_4, Size=8, Justification=5)

evaluate_12 = Evaluate(Expression="P.x", P=orient_2.Geometry)
sort_list_9 = SortList(Keys=evaluate_12, ValuesValuesA=orient_2.Geometry)  # -> Keys, ValuesValuesA
curve_closest_point_6 = CurveClosestPoint(Point=sort_list_9.ValuesValuesA, Curve=move_8.Geometry)  # -> Point, Parameter, Distance

line_6 = Line(StartPoint=curve_closest_point_6.Point, EndPoint=sort_list_9.ValuesValuesA)
